test file "test_files"

suite "New Test Suite 1"

  case "Angle_Test" [simulation]
    model dsogi_pll_3ph, harness dsogi_pll_3ph_Harness4 (for dsogi_pll_3ph/Dsogi-PLL)
    assessment "Assessment1": At any point of time, whenever (Input_pha-Inp_b)~=0 is true then, with a delay of at most 0.05, ((3.3*sin_angle)-Input_pha)<.1 must be true
      sin_angle: signal dsogi_pll_3ph_Harness4/Dsogi-PLL/SRF_PLL/dco, port 2
      Input_pha: signal dsogi_pll_3ph_Harness4/Input Conversion Subsystem, port 1
      Inp_b: signal dsogi_pll_3ph_Harness4/Input Conversion Subsystem, port 2

  case "Phase_swap Phase 1 & 2" [simulation]
    model dsogi_pll_3ph, harness dsogi_pll_3ph_Harness1 (for dsogi_pll_3ph/Dsogi-PLL)
    assessment "Assessment1": At any point of time, if phase_swp becomes true then, with no delay, phase_swp must stay true for at least 0.001
      phase_swp: signal dsogi_pll_3ph_Harness1/Output Conversion Subsystem, port 2

  case "Phase_swap Phase 1 & 3" [simulation]
    model dsogi_pll_3ph, harness dsogi_pll_3ph_Harness2 (for dsogi_pll_3ph/Dsogi-PLL)
    assessment "Assessment1": At any point of time, if phase_swp becomes true then, with no delay, phase_swp must stay true for at least 0.001
      phase_swp: signal dsogi_pll_3ph_Harness1/Output Conversion Subsystem, port 2

  case "Phase_swap Phase 2 & 3" [simulation]
    model dsogi_pll_3ph, harness dsogi_pll_3ph_Harness3 (for dsogi_pll_3ph/Dsogi-PLL)
    assessment "Assessment1": At any point of time, if phase_swp becomes true then, with no delay, phase_swp must stay true for at least 0.001
      phase_swp: signal dsogi_pll_3ph_Harness1/Output Conversion Subsystem, port 2